# Dynamo graph Basic_Primitive_Nodes.dyn (Dynamo 3.0.3.7597)

bySphereCenterRadius = AnyCAD.UserNodes.Elements.UserShapeNode.BySphereCenterRadius()
code_block = CodeBlock { 3; 5; -0.5; 8; 12; Math.PI * 2; Math.PI; }
byOrigin = CoordinateSystem.ByOrigin(x=code_block.out0)
byConeAxisRadiusHeight = AnyCAD.UserNodes.Elements.UserShapeNode.ByConeAxisRadiusHeight(cs=byOrigin, height=code_block.out0)
code_block_2 = CodeBlock { 231; 213; 124; }
nijika_yellow = Color.ByARGB(red=code_block_2.out0, green=code_block_2.out1, blue=code_block_2.out2)
seColor = AnyCAD.CoreNodes.Elements.ShapeElementNode.SeColor(shape=byConeAxisRadiusHeight, color=nijika_yellow)
byOrigin_2 = CoordinateSystem.ByOrigin(x=code_block.out1, y=code_block.out2)
byBoxAxisLengths = AnyCAD.UserNodes.Elements.UserShapeNode.ByBoxAxisLengths(cs=byOrigin_2)
code_block_3 = CodeBlock { 238; 183; 197; }
boochi_pink = Color.ByARGB(red=code_block_3.out0, green=code_block_3.out1, blue=code_block_3.out2)
seColor_2 = AnyCAD.CoreNodes.Elements.ShapeElementNode.SeColor(shape=byBoxAxisLengths, color=boochi_pink)
byOrigin_3 = CoordinateSystem.ByOrigin(x=code_block.out3)
byCylinderAxisRadiusHeight = AnyCAD.UserNodes.Elements.UserShapeNode.ByCylinderAxisRadiusHeight(cs=byOrigin_3, height=code_block.out1)
code_block_4 = CodeBlock { 210; 86; 78; }
ikuyo_red = Color.ByARGB(red=code_block_4.out0, green=code_block_4.out1, blue=code_block_4.out2)
seColor_3 = AnyCAD.CoreNodes.Elements.ShapeElementNode.SeColor(shape=byCylinderAxisRadiusHeight, color=ikuyo_red)
byOrigin_4 = CoordinateSystem.ByOrigin(x=code_block.out4)
code_block_5 = CodeBlock { 0.5; 1.5; }
byTorusMajorMinorAngle = AnyCAD.UserNodes.Elements.UserShapeNode.ByTorusMajorMinorAngle(cs=byOrigin_4, majorR=code_block_5.out1, minorR=code_block_5.out0, angle=code_block.out5)
code_block_6 = CodeBlock { 64; 97; 161; }
ryo_blue = Color.ByARGB(red=code_block_6.out0, green=code_block_6.out1, blue=code_block_6.out2)
seColor_4 = AnyCAD.CoreNodes.Elements.ShapeElementNode.SeColor(shape=byTorusMajorMinorAngle, color=ryo_blue)
